# Dynamo graph RoomIso.dyn (Dynamo 2.5.0.7460)

python_script = Python()  # unwired: IN[0]
# ---------- python_script.python (59 lines) ----------
import clr
import sys
import time

sys.path.append('C:\Program Files (x86)\IronPython 2.7\Lib')
import System
from System import Array
from System.Collections.Generic import *
clr.AddReference('ProtoGeometry')
from Autodesk.DesignScript.Geometry import *
clr.AddReference("RevitNodes")
import Revit
clr.ImportExtensions(Revit.Elements)
clr.ImportExtensions(Revit.GeometryConversion)
clr.AddReference("RevitServices")
import RevitServices
from RevitServices.Persistence import DocumentManager 
from RevitServices.Transactions import TransactionManager 

clr.AddReference("RevitAPI")
clr.AddReference("RevitAPIUI")

import Autodesk 
from Autodesk.Revit.DB import *
from Autodesk.Revit.UI import *

doc = DocumentManager.Instance.CurrentDBDocument
uiapp = DocumentManager.Instance.CurrentUIApplication 
app = uiapp.Application 
uidoc = uiapp.ActiveUIDocument

def createView(room):
	views = FilteredElementCollector(doc).OfClass(ViewFamilyType).ToElements()
	viewId = [v.Id for v in views if v.ViewFamily == ViewFamily.ThreeDimensional][0]
	roomName = room.get_Parameter(BuiltInParameter.ROOM_NAME).AsString()
	roomNumber = room.get_Parameter(BuiltInParameter.ROOM_NUMBER).AsString()
	
	viewNameString = roomName + "-" + roomNumber + "-ISO-" + str(milliseconds)
	t = Transaction(doc, "CreateRoomViews")
	t.Start()
	iso = View3D.CreateIsometric(doc, viewId)
	viewName = iso.get_Parameter(BuiltInParameter.VIEW_NAME)
	viewName.Set(viewNameString)
	t.Commit()
	return iso

rooms = FilteredElementCollector(doc).OfCategory(BuiltInCategory.OST_Rooms).WhereElementIsNotElementType().ToElements()

for room in rooms:
	milliseconds = int(round(time.time() * 1000))
	newView = createView(room)
	bbox = room.get_BoundingBox(newView)
	bbox.Min = XYZ(bbox.Min.X - 2.0, bbox.Min.Y - 2.0, bbox.Min.Z - 2.0)
	bbox.Max = XYZ(bbox.Max.X + 2.0, bbox.Max.Y + 2.0, bbox.Max.Z + 2.0)
	t = Transaction(doc, "SetSectionBox")
	t.Start()
	newView.SetSectionBox(bbox)
	t.Commit()
OUT = 0
# ----------------------------------------
